# Grasshopper definition A-2-2_ConvertToMesh.gh (Grasshopper 0.9.76)
# plug-ins: NumericalArchitectureCompilerForGH, NumericalGeoUtilsForGH

srf = Surface(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)

nsurface_class_for_geomerty_analysis = NSurface(
    S=srf,
    U=Slider(3, range=0..10),
    V=Slider(7, range=0..10),
    NS=1,
    AS=2,
    AF=0.5,
    ES=2,
    EF=0.5,
    RS=2,
    RF=0.5,
    SC=5,
    Tri=True,
    SG=10,
    SM=10)  # -> Surface, UInt, VInt, UCurve, VCurve, LinesNormal, LinesSlope, CurvaturePositive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
mesh = Mesh(nsurface_class_for_geomerty_analysis.Mesh)

brep_to_subdivision_mesh = PassABrepToSubdivisionMeshMeshToBrep(Brep=srf, Subdivision=Slider(1, range=0..10))  # -> Mesh, Point
mesh_2 = Mesh(brep_to_subdivision_mesh.Mesh)

# ---- group: GSD template
list = ValueList({"0 DEFPOINTS", "1 LASER-CUT", "2 LASER-SCORE", "3 LASER-SCORE-0", "4 LASER-SCORE-1", "5 LASER-SCORE-2", "6 LASER-SCORE-3", "7 LASER-SCORE-4"}, selected="0 DEFPOINTS")

list_2 = ValueList({"0 DEFPOINTS", "1 LASER-CUT", "2 LASER-SCORE", "3 LASER-SCORE-0", "4 LASER-SCORE-1", "5 LASER-SCORE-2", "6 LASER-SCORE-3", "7 LASER-SCORE-4"}, selected="4 LASER-SCORE-1")

# ----
bake_for_cutting = PassCBakeForCutting(Geometry=mesh, String=list, Boolean=Button())
bake_for_cutting_2 = PassCBakeForCutting(Geometry=mesh_2, String=list_2, Boolean=Button())
